# Grasshopper definition OpenAI.ghx (Grasshopper 1.0.7)
# plug-ins: brain_ghplugin

environment_variable = EnvironmentVariable(Name="openai")
panel = Panel("Stock photo of AI working hard to be useful, realistic, cg, 4K, raytraced")
models = ListModels(Send=Toggle(False), Authorization=environment_variable, Timeout=10000)  # -> Response, Models
completion = CreateCompletion(
    Send=Toggle(False),
    Authorization=environment_variable,
    Timeout=10000,
    Prompt="AI is becoming mainstream",
    ShowAdvanced=False)  # -> Response, Options
chat = CreateChatCompletion(
    Send=Toggle(False),
    Authorization=environment_variable,
    Timeout=10000,
    Content="What is your purpose?",
    ShowAdvanced=False)  # -> Response, Options
edit = CreateEdit(
    Send=Toggle(False),
    Authorization=environment_variable,
    Timeout=10000,
    Input="A flying dragon",
    Instruction="Write a conventional haiku",
    ShowAdvanced=False)  # -> Response, Result
image = CreateImage(Send=Toggle(False), Authorization=environment_variable, Timeout=10000, Prompt=panel, ShowAdvanced=False)  # -> Response, URL, Base64
panel_2 = Panel(models.Models)
panel_3 = Panel(completion.Options)
panel_4 = Panel(chat.Options)
panel_5 = Panel(edit.Result)
tobitmap = ConvertToBitmap(URL=image.URL, Base64=image.Base64)
viewer = ImageViewer(Bitmap=tobitmap)
path = FilePath("C:\Users\Lin\Pictures\")
savebitmap = SaveBitmapLocally(Dir=path, Bitmap=tobitmap, Save=Toggle(False))
panel_6 = Panel(savebitmap)
